# Dynamo graph codice-6-1-dynamo-box.dyn "cap-6-1-dynamo-box" (Dynamo 2.13.1.3887)
# O AABB: a caixa alinhada aos eixos em torno do segmento inclinado da EC-01. Academia do capítulo 6.1; abre também no Dynamo Sandbox.

code_block = CodeBlock { Point.ByCoordinates(27.204, 15.2, 4); Point.ByCoordinates(37.596, 21.2, 4); }
byStartPointEndPoint = Line.ByStartPointEndPoint(startPoint=code_block.out0, endPoint=code_block.out1)
byGeometry = BoundingBox.ByGeometry(geom=byStartPointEndPoint)
minPoint = BoundingBox.MinPoint(boundingBox=byGeometry)
watch = Watch(minPoint)
maxPoint = BoundingBox.MaxPoint(boundingBox=byGeometry)
watch_2 = Watch(maxPoint)
