# Dynamo graph codice-6-1-dynamo-piano.dyn "cap-6-1-dynamo-piano" (Dynamo 2.13.1.3887)
# O plano: o horizontal na cota +4.00 e a distância do ponto Q (z=4.05): 0.05 m. Academia do capítulo 6.1; abre também no Dynamo Sandbox.

code_block = CodeBlock { Point.ByCoordinates(0, 0, 4); Vector.ZAxis(); Point.ByCoordinates(32.4, 18.2, 4.05); }
byOriginNormal = Plane.ByOriginNormal(origin=code_block.out0, normal=code_block.out1)
distanceTo = Geometry.DistanceTo(geometry=byOriginNormal, other=code_block.out2)
watch = Watch(distanceTo)
