# Dynamo graph codice-6-1-dynamo-punto.dyn "cap-6-1-dynamo-punto" (Dynamo 2.13.1.3887)
# O ponto: as extremidades do eixo da EC-01 e a distância entre elas (12 m). Academia do capítulo 6.1; abre também no Dynamo Sandbox.

code_block = CodeBlock { Point.ByCoordinates(27.204, 15.2, 4); Point.ByCoordinates(37.596, 21.2, 4); }
distanceTo = Geometry.DistanceTo(geometry=code_block.out0, other=code_block.out1)
watch = Watch(distanceTo)
