# Dynamo graph codice-6-1-dynamo.dyn "cap-6-1-dynamo" (Dynamo 2.13.1.3887)
# Grafo do capítulo 6.1 (primitivas geométricas): o segmento da EC-01, o produto escalar e o ângulo -- geometria pura, abre também no Dynamo Sandbox.

code_block = CodeBlock { Point.ByCoordinates(0, 0, 0); Point.ByCoordinates(12 * Math.Cos(30), 12 * Math.Sin(30), 0); }
byStartPointEndPoint = Line.ByStartPointEndPoint(startPoint=code_block.out0, endPoint=code_block.out1)
length = Curve.Length(curve=byStartPointEndPoint)
watch = Watch(length)
code_block_2 = CodeBlock { Vector.ByCoordinates(Math.Cos(30), Math.Sin(30), 0); }
code_block_3 = CodeBlock { Vector.ByCoordinates(1, 0, 0); }
dot = Vector.Dot(vector=code_block_2, otherVector=code_block_3)
watch_2 = Watch(dot)
angleWithVector = Vector.AngleWithVector(vector=code_block_2, otherVector=code_block_3)
watch_3 = Watch(angleWithVector)
