# Dynamo graph codice-7-1-dynamo.dyn (Dynamo 3.3.0.6316)
# Forometria in Dynamo - il clash esatto: i solidi dei conduit scelti contro le strutture del link, DirectShape per il coordinamento

# group: 1 - I conduit scelti, in geometria
select_model_elements = DSModelElementMultipleSelection()  # nothing selected
geometry = Element.Geometry(element=select_model_elements)

# group: 2 - Il link e la scrematura a scatole
select_model_element = DSModelElementSelection()  # nothing selected
le_strutture_vicine_python = Python(IN[0]=select_model_element, IN[1]=select_model_elements)  # CPython3
# ---------- le_strutture_vicine_python.python (64 lines) ----------
# Le strutture del link vicine ai conduit scelti, nel nostro mondo.
# La scrematura a scatole (Parte 6) vive qui: si convertono SOLO i
# solidi che possono toccare i conduit, non tutto il link.
import clr
clr.AddReference('RevitAPI')
from Autodesk.Revit.DB import (FilteredElementCollector,
    BuiltInCategory, Options, Solid, GeometryInstance, XYZ)
clr.AddReference('RevitNodes')
import Revit
clr.ImportExtensions(Revit.GeometryConversion)

link   = UnwrapElement(IN[0])          # RevitLinkInstance
scelti = [UnwrapElement(e) for e in IN[1]]
ldoc = link.GetLinkDocument()
tr   = link.GetTotalTransform()        # mondo del link -> il nostro
inv  = tr.Inverse
cs   = tr.ToCoordinateSystem()

def scatola(el, t=None):
    bb = el.get_BoundingBox(None)
    if bb is None:
        return None
    if t is None:
        return (bb.Min.X, bb.Min.Y, bb.Min.Z,
                bb.Max.X, bb.Max.Y, bb.Max.Z)
    xs, ys, zs = [], [], []
    for x in (bb.Min.X, bb.Max.X):
        for y in (bb.Min.Y, bb.Max.Y):
            for z in (bb.Min.Z, bb.Max.Z):
                p = t.OfPoint(XYZ(x, y, z))
                xs.append(p.X); ys.append(p.Y); zs.append(p.Z)
    return (min(xs), min(ys), min(zs), max(xs), max(ys), max(zs))

def si_toccano(a, b, g=0.5):           # gioco in piedi (~15 cm)
    return (a[0]-g <= b[3] and b[0]-g <= a[3] and
            a[1]-g <= b[4] and b[1]-g <= a[4] and
            a[2]-g <= b[5] and b[2]-g <= a[5])

# le scatole dei conduit scelti, portate nel mondo del link
scatole = [s for s in (scatola(el, inv) for el in scelti) if s]

CATEGORIE = [BuiltInCategory.OST_Walls,
             BuiltInCategory.OST_Floors,
             BuiltInCategory.OST_StructuralFraming]
solidi, scartati = [], 0
for cat in CATEGORIE:
    for el in (FilteredElementCollector(ldoc).OfCategory(cat)
               .WhereElementIsNotElementType()):
        b = scatola(el)
        if b is None or not any(si_toccano(a, b) for a in scatole):
            continue                   # lontano: non si converte
        for g in el.get_Geometry(Options()):
            pezzi = (g.GetInstanceGeometry()
                     if isinstance(g, GeometryInstance) else [g])
            for s in pezzi:
                if isinstance(s, Solid) and s.Volume > 1e-6:
                    # qualche faccia non sopravvive alla
                    # conversione Revit -> Dynamo: si salta
                    try:
                        solidi.append(
                            s.ToProtoType().Transform(cs))
                    except Exception:
                        scartati += 1
OUT = solidi
# ----------------------------------------

# group: 3 - Il clash: solido contro solido
intersect = Geometry.Intersect(geometry=geometry, other=le_strutture_vicine_python, lacing=CrossProduct)
i_volumi_del_clash = CodeBlock(inter=intersect) { List.Clean(List.Flatten(inter, -1), false); }

# group: 4 - La posa per il coordinamento
categories = Categories("OST_GenericModel")
il_nome_della_directshape = CodeBlock { "Clash conduit"; }
byGeometry = DirectShape.ByGeometry(geometry=i_volumi_del_clash, category=categories, name=il_nome_della_directshape)
count = List.Count(list=byGeometry)
clash_trovati = Watch(count)
