# Dynamo graph codice-8-3-dynamo.dyn "cap-7-1-staffaggio" (Dynamo 2.13.1.3887)
# Grafo del capitolo 7.1 (staffaggio): lettura, calcolo e scrittura delle staffe.

select_model_element = DSModelElementSelection()  # nothing selected
code_block = CodeBlock { "Length"; ["FG16 4G95","FG16 5G16","FG16 3G2.5"]; }
getParameterValueByName = Element.GetParameterValueByName(element=select_model_element, parameterName=code_block.out0)
getParameterValueByName_2 = Element.GetParameterValueByName(element=select_model_element, parameterName=code_block.out1)
python_script = Python(IN[0]=getParameterValueByName, IN[1]=getParameterValueByName_2)  # CPython3
# ---------- python_script.python (21 lines) ----------
# Cap. 7.1 - Calcolo delle staffe (support spacing)
import math

# --- input dal grafo ---
L   = IN[0]           # lunghezza del tratto (m)
qta = IN[1]           # [n1, n2, n3] quantita' dei cavi lette dal modello

# --- dati di progetto (catalogo) ---
w_pass  = 5.00                 # kg/m, peso proprio della passerella
pesi    = [4.10, 1.35, 0.18]   # kg/m per FG16 4G95 / 5G16 / 3G2.5
i       = 1.50                 # m, interasse di progetto
portata = 152.9                # kg, portata staffa 41/600 (1500 N)

# --- calcolo ---
w = w_pass + sum(p * n for p, n in zip(pesi, qta))   # peso al metro
F = w * i                                            # carico sulla staffa interna
N = int(math.ceil(L / i)) + 1                        # numero di staffe
esito = "CONFORME" if F <= portata else "NON VERIFICATO"

# --- output: [numero di staffe, interasse] ---
OUT = [N, i]
# ----------------------------------------
code_block_2 = CodeBlock(OUT=python_script) { OUT[0]; OUT[1]; }
watch = Watch(code_block_2.out0)
code_block_3 = CodeBlock { "Staffe n"; "Staffe interasse"; }
setParameterByName = Element.SetParameterByName(element=select_model_element, parameterName=code_block_3.out0, value=code_block_2.out0, lacing=Longest)
setParameterByName_2 = Element.SetParameterByName(element=select_model_element, parameterName=code_block_3.out1, value=code_block_2.out1, lacing=Longest)
